# Dynamo graph BadStuffCleanup.dyn (Dynamo 1.3.2.2480)

# group: Find the API folder with the keys and server name
string = StringInput("D:\Source\case-apps\2018")
contentsAll = Custom[Directory.ContentsAll](directoryPath=string)  # Unlike the built-in node Directory.Contents, this node browses a directory recursively and returns all relevant files contained in subfolders as well.
string_from_object = FromObject(contentsAll)
code_block = CodeBlock { "\\API\\"; }
contains = String.Contains(str=string_from_object, searchFor=code_block)
filterByBoolMask = List.FilterByBoolMask(list=string_from_object, mask=contains)

# group: Build a new directory path to delete
code_block_2 = CodeBlock { "\\"; }
lastIndexOf = String.LastIndexOf(filterByBoolMask.in, code_block_2)
length = String.Length(filterByBoolMask.in)
sub = length - lastIndexOf
remove = String.Remove(str=filterByBoolMask.in, startIndex=lastIndexOf, count=sub)

# group: Delete that stuff!
code_block_3 = CodeBlock { true; }
delete = Directory.Delete(remove, code_block_3)
