# Dynamo graph copyRelease.dyn (Dynamo 2.17.0.3472)

string = StringInput("D:\repos_john\case-apps\src\")
string_2 = StringInput("D:\repos_john\case-apps\deploy\2023")
directory_from_path = DirectoryObject(path=string_2)
code_block = CodeBlock { "*.dll"; }
getDirectoryContents = FileSystem.GetDirectoryContents(directory=directory_from_path, searchString=code_block)
code_block_2 = CodeBlock { -2; }
dropItems = List.DropItems(list=getDirectoryContents.files, amount=code_block_2)
code_block_3 = CodeBlock { false; }
fileName = FileSystem.FileName(path=dropItems, withExtension=code_block_3)
version = StringInput("2021")
fileName_2 = FileSystem.FileName(path=dropItems)
code_block_4 = CodeBlock(path=string, name=fileName, version=version, fileNameExt=fileName_2) { path + name + "\\" + name + "."+version + "\\bin\\Release\\" + fileNameExt; }
file_from_path = FileObject(path=code_block_4)
string_3 = StringInput("D:\repos_john\case-apps\deploy\")
code_block_5 = CodeBlock(path=string_3, version=version, fileNameExt=fileName_2) { path + version + "\\" + fileNameExt; }
code_block_6 = CodeBlock { true; }
copyFile = FileSystem.CopyFile(file=file_from_path, destinationPath=code_block_5, overwrite=code_block_6)
