# Dynamo graph draftRelease.dyn (Dynamo 2.11.0.4533)

string = StringInput("C:\Users\johnpierson\Desktop\Dev\case-apps\Case.AppsRibbon.2019")
directory_from_path = DirectoryObject(path=string)
code_block = CodeBlock { 1; }
getDirectoryContents = FileSystem.GetDirectoryContents(directory=directory_from_path, includeSubdirectories=code_block)
string_2 = StringInput("C:\Users\johnpierson\Desktop\Dev\case-apps\2019")
directory_from_path_2 = DirectoryObject(path=string_2)
code_block_2 = CodeBlock { 1; }
getDirectoryContents_2 = FileSystem.GetDirectoryContents(directory=directory_from_path_2, includeSubdirectories=code_block_2)
list_create = List.Create(item0=getDirectoryContents.files, item1=getDirectoryContents_2.files)
flatten = List.Flatten(list=list_create)
fileName = FileSystem.FileName(path=flatten)
groupByKey = List.GroupByKey(list=flatten, keys=fileName)
firstItem = List.FirstItem(list=groupByKey.groups@L2)
byKeysValues = DesignScript.Builtin.Dictionary.ByKeysValues(keys=groupByKey.uniqueKeys, values=firstItem)
string_3 = StringInput("C:\Users\johnpierson\Desktop\Dev\case-apps\deploy\2021")
directory_from_path_3 = DirectoryObject(path=string_3)
code_block_3 = CodeBlock { 1; }
getDirectoryContents_3 = FileSystem.GetDirectoryContents(directory=directory_from_path_3, includeSubdirectories=code_block_3)
flatten_2 = List.Flatten(list=getDirectoryContents_3.files)
fileName_2 = FileSystem.FileName(path=flatten_2)
valueAtKey = DesignScript.Builtin.Dictionary.ValueAtKey(dictionary=byKeysValues, key=fileName_2)
file_from_path = FileObject(path=valueAtKey)
string_4 = StringInput("C:\Users\johnpierson\Desktop\Dev\case-apps\deploy\2019")
fileName_3 = FileSystem.FileName(path=valueAtKey)
code_block_4 = CodeBlock(x=string_4, y=fileName_3) { x + "\\"+ y; }
copyFile = FileSystem.CopyFile(file=file_from_path, destinationPath=code_block_4)
