# Dynamo graph version.dyn (Dynamo 2.17.0.3472)

string = StringInput("AssemblyVersion(\"")
string_2 = StringInput("\")]\n")
string_3 = StringInput("D:\repos_john\case-apps\src")
directory_from_path = DirectoryObject(path=string_3)
code_block = CodeBlock { true; }
getDirectoryContents = FileSystem.GetDirectoryContents(directory=directory_from_path, includeSubdirectories=code_block)
fileName = FileSystem.FileName(path=getDirectoryContents.files)
string_4 = StringInput("AssemblyInfo")
contains = String.Contains(string=fileName, searchFor=string_4)
filterByBoolMask = List.FilterByBoolMask(list=getDirectoryContents.files, mask=contains)
readText = FileSystem.ReadText(file=filterByBoolMask.in)
string_5 = StringInput("17.6.8.0")
string_6 = StringInput("23.2.23.0")
replace = String.Replace(string=readText, searchFor=string_5, replaceWith=string_6)
writeText = FileSystem.WriteText(filePath=filterByBoolMask.in, text=replace)
